# Grasshopper definition Fan Simulator 3000.gh (Grasshopper 1.0.7)
# plug-ins: Pufferfish, Human

# ---- group: Parameter Panel (PP) / Outside parameters
blade_thickness_x2_mm_outside_bottom = Slider(3, range=0..3)
aoa_outside_x_comp = Slider(24.5, range=0..35)
blade_thickness_x2_mm_outside_top = Slider(3, range=0..3)
blade_profile_curvature = Slider(0.83, range=0.5..0.9)

# ---- group: Parameter Panel (PP) / Inside Parameters
aoa_inside_x_comp = Slider(7, range=0..7)
blade_thickness_x2_mm_inside = Slider(2.7, range=0.1..3)
blade_profile_curvature_2 = Slider(0.5, range=0.5..0.9)

# ---- group: Parameter Panel (PP) / Joint Parameters
# 0 sharp edge
# 1 extra sharp edge
# 2 blunt edge
blade_curvature_xy_plane_5_for_straight = Slider(0.59, range=0..1)
blade_edge_type = Slider(1, range=0..2)
blade_count = Slider(11, range=0..50)
height = Slider(16.5, range=10..40)
blade_sweep_curve_input = Curve(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)

# ----
generate_fan = Button()

calculation = Calculation(A_2=height, A=aoa_inside_x_comp)  # -> degrees_2, radians
aoa_inside_degrees = Panel(calculation.degrees_2)

calculation_2 = Calculation(A_2=height, A=aoa_outside_x_comp)  # -> degrees_2, radians
aoa_outside_degrees = Panel(calculation_2.degrees_2)

# ---- group: Inside Blade Profile Creation
x = Multiplication(A=blade_thickness_x2_mm_inside, B=-1)
addition = Addition(A=x, B=aoa_inside_x_comp)
subtraction = Subtraction(A=blade_thickness_x2_mm_inside, B=aoa_inside_x_comp)
subtraction_2 = Subtraction(A=x, B=aoa_inside_x_comp)
addition_2 = Addition(A=blade_thickness_x2_mm_inside, B=aoa_inside_x_comp)
subtraction_3 = Subtraction(A=height, B=2)
slide_domain = ConstructDomain(DomainStart=0, DomainEnd=height)
number_slider = Slider(18.8, range=18..20)
merge = Merge(Data1=height, Data2=height, Data3=subtraction_3)
merge_2 = Merge(Data1=subtraction, Data2=subtraction_2, Data3=subtraction_2)
slide_within_domain = SlideWithinDomain(Domain=slide_domain, Factor=blade_profile_curvature_2)
list_item = ListItem(List=merge, Index=blade_edge_type, Wrap=True)
list_item_2 = ListItem(List=merge_2, Index=blade_edge_type, Wrap=True)
make_pt = ConstructPoint(XCoordinate=list_item_2, YCoordinate=19, ZCoordinate=height)
make_pt_2 = ConstructPoint(XCoordinate=subtraction_2, YCoordinate=19, ZCoordinate=list_item)
make_pt_3 = ConstructPoint(XCoordinate=blade_thickness_x2_mm_inside, YCoordinate=number_slider, ZCoordinate=slide_within_domain)
make_pt_4 = ConstructPoint(XCoordinate=x, YCoordinate=number_slider, ZCoordinate=slide_within_domain)
make_pt_5 = ConstructPoint(XCoordinate=addition_2, YCoordinate=19, ZCoordinate=0)
make_pt_6 = ConstructPoint(XCoordinate=addition, YCoordinate=19, ZCoordinate=0)
bottom_merge = Merge(Data1=make_pt_2, Data2=make_pt_4, Data3=make_pt_6)
top_merge = Merge(Data1=make_pt, Data2=make_pt_3, Data3=make_pt_5)
interpolate = Interpolate(Vertices=bottom_merge, Degree=3, Periodic=False, KnotStyle=1)  # -> Curve, Length, Domain
interpolate_2 = Interpolate(Vertices=top_merge, Degree=3, Periodic=False, KnotStyle=1)  # -> Curve, Length, Domain
line = Line(StartPoint=make_pt, EndPoint=make_pt_2)
line_2 = Line(StartPoint=make_pt_6, EndPoint=make_pt_5)
merge_3 = Merge(Data1=line, Data2=interpolate.Curve, Data3=line_2, Data4=interpolate_2.Curve)
join_curves = JoinCurves(Curves=merge_3, Preserve=False)

# ---- group: Outside Blade Profile Creation
x_2 = Multiplication(A=blade_thickness_x2_mm_outside_top, B=-1)
x_3 = Multiplication(A=blade_thickness_x2_mm_outside_top, B=-1)
subtraction_4 = Subtraction(A=blade_thickness_x2_mm_outside_top, B=aoa_outside_x_comp)
subtraction_5 = Subtraction(A=x_2, B=aoa_outside_x_comp)
radius_of_countours_from_center = Slider(18.8, range=18..20)
slide_domain_2 = ConstructDomain(DomainStart=0, DomainEnd=height)
subtraction_6 = Subtraction(A=height, B=1)
addition_3 = Addition(A=blade_thickness_x2_mm_outside_bottom, B=aoa_outside_x_comp)
addition_4 = Addition(A=x_3, B=aoa_outside_x_comp)
merge_4 = Merge(Data1=subtraction_4, Data2=subtraction_5, Data3=subtraction_5)
merge_5 = Merge(Data1=height, Data2=height, Data3=subtraction_6)
slide_within_domain_2 = SlideWithinDomain(Domain=slide_domain_2, Factor=blade_profile_curvature)
list_item_3 = ListItem(List=merge_4, Index=blade_edge_type, Wrap=True)
list_item_4 = ListItem(List=merge_5, Index=blade_edge_type, Wrap=True)
make_pt_7 = ConstructPoint(XCoordinate=list_item_3, YCoordinate=radius_of_countours_from_center, ZCoordinate=height)
make_pt_8 = ConstructPoint(XCoordinate=subtraction_5, YCoordinate=radius_of_countours_from_center, ZCoordinate=list_item_4)
make_pt_9 = ConstructPoint(
    XCoordinate=blade_thickness_x2_mm_outside_top,
    YCoordinate=radius_of_countours_from_center,
    ZCoordinate=slide_within_domain_2)
make_pt_10 = ConstructPoint(XCoordinate=x_3, YCoordinate=radius_of_countours_from_center, ZCoordinate=slide_within_domain_2)
make_pt_11 = ConstructPoint(XCoordinate=addition_3, YCoordinate=radius_of_countours_from_center, ZCoordinate=0)
make_pt_12 = ConstructPoint(XCoordinate=addition_4, YCoordinate=radius_of_countours_from_center, ZCoordinate=0)
merge_6 = Merge(Data1=make_pt_8, Data2=make_pt_10, Data3=make_pt_12)
merge_7 = Merge(Data1=make_pt_7, Data2=make_pt_9, Data3=make_pt_11)
interpolate_3 = Interpolate(Vertices=merge_6, Degree=3, Periodic=False, KnotStyle=1)  # -> Curve, Length, Domain
interpolate_4 = Interpolate(Vertices=merge_7, Degree=3, Periodic=False, KnotStyle=1)  # -> Curve, Length, Domain
line_3 = Line(StartPoint=make_pt_7, EndPoint=make_pt_8)
line_4 = Line(StartPoint=make_pt_12, EndPoint=make_pt_11)
merge_8 = Merge(Data1=line_3, Data2=interpolate_3.Curve, Data3=line_4, Data4=interpolate_4.Curve)
join_curves_2 = JoinCurves(Curves=merge_8, Preserve=False)

# ---- group: Patch Edges (Surface)
brep = Brep(<brep referenced from the Rhino model>)  # disabled
trim_solid = TrimSolid(Cutters=brep)  # disabled
brep_edges = BrepEdges(Brep=trim_solid)  # -> Naked, Interior, NonManifold; disabled
partition_list = PartitionList(List=brep_edges.Naked, Size=4)  # disabled
patch = Patch(Curves=partition_list, Spans=20, Flexibility=1, Trim=True)  # disabled
merge_9 = Merge(Data1=trim_solid, Data2=patch)  # disabled

# ----
mirror = Mirror(Geometry=blade_sweep_curve_input, Plane=PlaneYZ(0, 0, 0))  # -> Geometry, Transform
tween_count_blade_rib = Slider(20, range=0..100)
merge_10 = Merge(Data1=mirror.Geometry, Data2=blade_sweep_curve_input)
series = Series(Start=1, Step=1, Count=tween_count_blade_rib)
division = Division(A=series, B=tween_count_blade_rib)

# ---- group: Pufferfish Plugin Needed
tween_through_curves_along_curve = TweenThroughCurvesAlongCurve(
    Curves=merge_10,
    Guide1=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,
    Factor=blade_curvature_xy_plane_5_for_straight,
    Normalized=True,
    Equalized=True,
    Refit=0,
    PointSample=0)

# ----
curve_array = CurveArray(Geometry=join_curves, Curve=tween_through_curves_along_curve, Count=tween_count_blade_rib)  # -> Geometry, Transform
curve_array_2 = CurveArray(Geometry=join_curves_2, Curve=tween_through_curves_along_curve, Count=tween_count_blade_rib)  # -> Geometry, Transform

# ---- group: Pufferfish Plugin Needed
tween_two_curves = TweenTwoCurves(CurveA=curve_array.Geometry, CurveB=curve_array_2.Geometry, Factor=division, Refit=0, PointSample=0)

# ---- group: loft option
_3d_blade_creation = Loft(
    Curves=tween_two_curves,
    Options={Adjust=False, Closed=False, LoftEnds=0, LoftSimp=0, LoftType=0, Rebuild=10, Refit=0.01})

# ---- group: Patch Edges (Mesh)
blade_mesh = MeshBrep(
    Brep=_3d_blade_creation,
    Settings={GridMaxCount=0, GridMinCount=16, JaggedSeams=False, MaxEdgeLength=0, MinEdgeLength=0.0001, MinTolerance=0, Refine=True, RefineAngle=0, RelativeTolerance=0.65, SimplePlanes=True, Tolerance=0})
bounding_mesh = MeshBrep(
    Brep=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,
    Settings={GridMaxCount=0, GridMinCount=16, JaggedSeams=False, MaxEdgeLength=0, MinEdgeLength=0.0001, MinTolerance=0, Refine=True, RefineAngle=0, RelativeTolerance=0.65, SimplePlanes=True, Tolerance=0})
closed_blade_mesh = CloseMesh(Mesh=blade_mesh, Quadrangulate=True)  # -> Closed, Amount, Openings, ResultBoolean
mesh_difference = MeshDifference(MeshesA=closed_blade_mesh.Closed, MeshesB=bounding_mesh)
blade_polar_array = PolarArray(Geometry=mesh_difference, Plane=PlaneXY(0, 0, 0), Count=blade_count, Angle=6.283185307)  # -> Geometry, Transform

# ---- group: Hub-blade Join
hub_adapter_mesh = Mesh(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)
merge_11 = Merge(Data1=hub_adapter_mesh, Data2=blade_polar_array.Geometry)  # -> flatten(Result)
mesh_join = MeshJoin(Meshes=merge_11)

# ----
bake_geometry = BakeGeometry(Bake=generate_fan, Geometry=mesh_join, DeleteOldBakes=False, PreserveTrees=False)

# ==== cluster Calculation
A = ClusterInput()
multiplication = Multiplication(A=A, B=2)
A_2 = ClusterInput()
division = Division(A=A_2, B=multiplication)
arctangent = ArcTangent(Value=division)
degrees = Degrees(Radians=arctangent)
degrees_2 = ClusterOutput(degrees)
radians = ClusterOutput(arctangent)
